# Dynamo graph WekaTest.dyn (Dynamo 1.1.1.2352)

code_block = CodeBlock { "test"; "test2"; {"yes","no"}; }
byNumericAtttribute = WekaDynamo.WekaTrees.ByNumericAtttribute(code_block.out0)
code_block_2 = CodeBlock { {"85,no","90,yes","85,no","95,yes","85,no","100,yes","85,no","86,yes"}; }
string = StringInput("""@relation weather

@attribute outlook {sunny, overcast, rainy}
@attribute temperature numeric
@attribute humidity numeric
@attribute windy {TRUE, FALSE}
@attribute play {yes, no}

@data
sunny,85,85,FALSE,no
sunny,80,90,TRUE,no
overcast,83,86,FALSE,yes
rainy,70,96,FALSE,yes
rainy,68,80,FALSE,yes
rainy,65,70,TRUE,no
overcast,64,65,TRUE,yes
sunny,72,95,FALSE,no
sunny,69,70,FALSE,yes
rainy,75,80,FALSE,yes
sunny,75,70,TRUE,yes
overcast,72,90,TRUE,yes
overcast,81,75,FALSE,yes
rainy,71,91,TRUE,no""")
code_block_3 = CodeBlock { "wekatree"; }
byNumericAtttribute_2 = WekaDynamo.WekaTrees.ByNumericAtttribute(code_block.out1)
byNominalAtttribute = WekaDynamo.WekaTrees.ByNominalAtttribute(code_block.out0, code_block.out2)
create = List.Create(byNumericAtttribute_2, byNominalAtttribute)
boolean = BoolSelector(false)
runNumbers = WekaDynamo.WekaTrees.RunNumbers(boolean)
createARFF = WekaDynamo.WekaTrees.CreateARFF(code_block_3, create, runNumbers)
byARFF = WekaDynamo.WekaTrees.ByARFF(createARFF.out0, createARFF.out1)
returnToString = WekaDynamo.WekaTrees.ReturnToString(byARFF)
returnToSummaryString = WekaDynamo.WekaTrees.ReturnToSummaryString(byARFF)
returnPrefix = WekaDynamo.WekaTrees.ReturnPrefix(byARFF)
getConfidenceFactor = WekaDynamo.WekaTrees.getConfidenceFactor(byARFF)
returnIfThen = WekaDynamo.WekaTrees.ReturnIfThen(byARFF)
code_block_4 = CodeBlock { "throws Exception"; ""; }
replace = String.Replace(str=returnIfThen, searchFor=code_block_4.out0, replaceWith=code_block_4.out1)
code_block_5 = CodeBlock { "Object"; "java.lang.Object"; }
replace_2 = String.Replace(str=replace, searchFor=code_block_5.out0, replaceWith=code_block_5.out1)
code_block_6 = CodeBlock { "Double"; "java.lang.Double"; }
replace_3 = String.Replace(str=replace_2, searchFor=code_block_6.out0, replaceWith=code_block_6.out1)
code_block_7 = CodeBlock { 0; }
code_block_8 = CodeBlock { "using System; using System.Collections.Generic; "; }
insert = String.Insert(str=replace_3, index=code_block_7, toInsert=code_block_8)
length = String.Length(insert)
code_block_9 = CodeBlock()
# ---------- code_block_9.designscript (11 lines) ----------
"List<double> dataOut = new List<double>();
int count = IN.Count;
java.lang.Object[] dataIn = new java.lang.Object[1];
for (int ii=0;
 ii<count;
 ii++){
 dataIn[0] = new java.lang.Double((int) IN[ii]) as java.lang.Object;
 dataOut.Add(wekaIf.classify(dataIn));
}
return dataOut;
";
# ----------------------------------------
insert_2 = String.Insert(str=insert, index=length, toInsert=code_block_9)
code_block_10 = CodeBlock { 0..100; }
file_path = Filename("ikvmbin-7.2.4630.5\ikvm-7.2.4630.5\bin\IKVM.OpenJDK.Core.dll")
fromString = Scripting.CSharpScript.FromString(insert_2, code_block_10, file_path)
code_block_11 = CodeBlock { 1; }
eq = fromString == code_block_11
code_block_12 = CodeBlock { "on"; "off"; }
if_ = If(test=eq, true=code_block_12.out0, false=code_block_12.out1)
